# Dynamo custom node OTL_Create_propertset_definitions.dyf (Dynamo 3.6.1.9956)
# category: Civil3D_OTL_MOW_Toolkit
# Methode om vanuit een OTL subset propertysetdefinitions aan te maken in een dwg. Download en gebruikt hiervoor een JSON met OTL info (zoals oa dotnotatie) vanop github.

# group: OTL_Create_propertset_defintions
OTL_Subset = Input(OTL_Subset: string = "")  # pad naar OTL subset db in sqlite
Enkel_subset_attributen = Input(Enkel_subset_attributen: bool = true)  # Bij 'True' worden enkel de attributen uit de susbet aangemaakt, bij 'False' alle OTL attributen voor de klasses in de subset
Enkel_subset_objecten = Input(Enkel_subset_objecten: bool = true)  # Bij 'True' worden enkel propertysets aangemaakt voor de objecten in de subset, bij 'False' voor alle instantieerbare objecten uit de OTL
check_input_folders_and_db = Python(IN[0]=OTL_Subset, IN[1]=Enkel_subset_attributen, IN[2]=Enkel_subset_objecten)  # CPython3
# ---------- check_input_folders_and_db.python (86 lines) ----------
# Load the Python Standard and DesignScript Libraries
import os.path
import ctypes
import sqlite3

# The inputs to this node will be stored as a list in the IN variables.
subset_db = IN[0]
subset_filter = IN[1]#filter op de attributen
objecten_filter = IN[2]#filter op de objecten of full OTL

# Main variables
nl = "\n"

# Functies
def create_connection(db_file):
    """ maak connectie naar de SQLite database"""
    conn = None
    try:
        conn = sqlite3.connect(db_file)
    except Error as e:
        print(e)
    return conn


def select_klasses(conn):
    """klasses uit sqlite ophalen"""
    conn = create_connection(conn)
    klasses_in_subset = []
    with conn:
        cur = conn.cursor()
        cur.execute("SELECT name FROM sqlite_master WHERE type='table' AND name='OSLOClass';")
        bestaat_klassetabel = cur.fetchall()
        if bestaat_klassetabel:
            cur.execute("SELECT uri FROM OSLOClass WHERE abstract = '0';")
            klasses_in_subset = cur.fetchall()
            klasses_in_subset = klasses_in_subset[0]
    return klasses_in_subset

def check_subset_geldigheid(db_pad):
    """Kijkt na of de input een geldige OTL db is"""
    geldige_db_pad = ""
    message = ""
    if isinstance(db_pad, str):
        if os.path.exists(db_pad) and db_pad:
            extensie = db_pad.split(".")[-1]
            if extensie == "db":
                geldige_db_pad = db_pad
                #message = f"Geldige subset input:{nl}{db_pad}"
            else:
                message = f"ONGELDIGE subset input: Bestand is geen .db bestand:{nl}{db_pad}"

        elif db_pad == "":
                message = f"Geen bruikbare input gevonden.{nl}Geef een geldige subset op,{nl}Of zet 'Enkel_subset_objecten' op 'false' om de volledige OTL te gebruiken. (Dit kan even duren)"
        
            
        else:
            message = f"ONGELDIGE subset input: Geen geldige subset gevonden:{nl}{db_pad}"
    else:
        message = f"ONGELDIGE subset input: bestand kon niet worden gevonden:{nl}{db_pad}"

    if geldige_db_pad:
        onderdelen = select_klasses(geldige_db_pad)
        if len(onderdelen) == 0:
            message = f"ONGELDIGE subset input: Geen OTL klassen gevonden in db file:{nl}{db_pad}"
            geldige_db_pad = ""

    return geldige_db_pad,message


# MAIN
if objecten_filter:
    subsetpad, subsetmessage = check_subset_geldigheid(subset_db)
    go = True
    
    if subsetmessage:
        ctypes.windll.user32.MessageBoxW(0, subsetmessage, "OTL_propertysetdefinitions_aanmaken", 0)
        go = False

else:
    go = True
    subsetpad = ""
    no_objfilter_message = f"Geen filtering op subset objecten:{nl}Er worden propertyset definitions aangemaakt voor alle instantieerbare OTL objecten. Dit kan even duren"
    ctypes.windll.user32.MessageBoxW(0, no_objfilter_message, "OTL_propertysetdefinitions_aanmaken", 0)

# OUT variable
OUT = subsetpad,subset_filter,objecten_filter,go
# ----------------------------------------
code_block = CodeBlock(out=check_input_folders_and_db) { subsetpad = out[0]; subset_filter = out[1]; objecten_filter = out[2]; go = out[3]; }
otldata_to_dict = Python(IN[0]=code_block.subsetpad, IN[1]=code_block.subset_filter, IN[2]=code_block.objecten_filter, IN[3]=code_block.go)  # CPython3
# ---------- otldata_to_dict.python (215 lines) ----------
import sqlite3
from sqlite3 import Error
from os.path import exists
import ctypes
import json
import urllib.request
import ssl

# Main variables
nl = "\n"

#FUNCTIES
def create_connection(db_file):
        """ maak connectie naar de SQLite database"""
        conn = None
        try:
            conn = sqlite3.connect(db_file)
        except Error as e:
            ctypes.windll.user32.MessageBoxW(0, str(e), "SQlite lezen gefaald", 0)
        return conn
    
    
def select_klasses(conn):
    """klasses uit sqlite ophalen"""
    conn = create_connection(conn)
    try:
        with conn:
            cur = conn.cursor()
            #klassen selecteren en daarbij abstracten, agents,bijlagen en relaties weglaten
            cur.execute("""
                SELECT k.uri FROM OSLOClass k 
                    WHERE abstract = '0' 
                    AND name NOT LIKE 'Agent' 
                    AND name NOT LIKE 'Bijlage' 
                    AND uri NOT LIKE 'https://wegenenverkeer.data.vlaanderen.be/ns/proefenmeting#%'
                    AND k.uri NOT IN (
                    SELECT DISTINCT uri
                    FROM OSLORelaties
                    );""")
            klasses_onderdelen_tuple = cur.fetchall()
            klasses_onderdelen = []
            for k in klasses_onderdelen_tuple:
                klasses_onderdelen.append(k[0])

            if len(klasses_onderdelen) > 100:
                ctypes.windll.user32.MessageBoxW(0, "Verwerking van meer dan 100 OTL types, dit kan enkele minuten duren..", "Inlezen OTL SQLite", 0)
    finally:
        if conn:
            conn.close()    
    return(klasses_onderdelen)

def select_attributen(conn, klasse_uri):
    """attributen voor klasse uit SQlite halen"""
    conn = create_connection(conn)
    try:
        with conn:
            cur = conn.cursor()
            #attributen voor bepaalde klasse ophalen
            cur.execute("""
                        SELECT a.name FROM OSLOAttributen a
                        WHERE class_uri = ?
                        """, (klasse_uri,))
            attributen_tuple = cur.fetchall()
            attributen = []
            for attr in attributen_tuple:
                attributen.append(attr[0])
    finally:
        if conn:
            conn.close()

    return(attributen)


def dummydict():
    onderdeeldict = {} #een dict om alle info voor een bepaalde propertyset in te verzamelen
    
    onderdeeldict["propertysetnaam"] = "OTL_dummy"
    onderdeeldict["definitie"] = "Een dummy object"
    onderdeeldict["typeURI"] = "dummyURI"
    onderdeeldict["attributen"] = []
    
    attribuutdict = {} # een dict per dotnotatie-attribuut
    
    attribuutdict["dotnotatie_attribuutnaam"] = "dummy.attribuut"
    attribuutdict["attribuutdefinitie"] = "Een dummy attribuut"
    attribuutdict["OTL_datatype_attribuut"] = "KlDummy"
    attribuutdict["civil3D_datatype_attribuut"] = "keuzelijst"
    attribuutdict["civil3D_default_value"] = '-'
    attribuutdict["keuzelijstopties"] = ['dummywaarde-A','dummywaarde-B','-']
    attribuutdict["keuzelijstnaam"] = 'dummy-lijst'
    
    onderdeeldict["attributen"].append(attribuutdict) #Voeg de attribuutinfo toe aan de dict voor dit onderdeel
    return onderdeeldict




def create_psetnaam(obj, urilijst):
    """Maakt de unieke propertysetnaam voor een object"""

    #Naam en soort van de klasse
    objectnaam = obj.__class__.__name__
    objectsoort = obj.typeURI.split('/')[-1].split('#')[0] #objectsoort afleiden uit typeURI

    #Deprecation label toevoegen
    if hasattr(obj, 'deprecated_version'):
        depr = "_DEPR-" + str(obj.deprecated_version)
    else:
        depr = ""

    #Controle of naam reeds voorkomt
    if sum(s.endswith('#' + objectnaam) for s in urilijst) == 1:
        propertysetnaam = "OTL_" + objectnaam + depr
    else: 
        propertysetnaam = "OTL_" + objectnaam + "_" + objectsoort + depr 

    return propertysetnaam



def OTL_info_json_afladen():
    """Laadt de json met OTL info (dotnotatie, datatypes, defaultvalues, keuzelijsten, ...) van github"""

    # De link naar het JSON bestand (met https:// toegevoegd)
    url = "https://raw.githubusercontent.com/rudewi/OTL_DotnotationMaker/refs/heads/main/OTL_Dotnotation_all_objects.json"

    # Bypass voor SSL-certificaat fouten (een veelvoorkomend probleem in Dynamo/Revit)
    ctx = ssl.create_default_context()
    ctx.check_hostname = False
    ctx.verify_mode = ssl.CERT_NONE

    try:
        # Haal de ruwe data op van de URL
        response = urllib.request.urlopen(url, context=ctx, timeout=30)
        ruwe_data = response.read().decode('utf-8')
        
        # Zet de ruwe tekst om naar een bruikbaar Python dictionary (JSON)
        json_data = json.loads(ruwe_data)


    except Exception as e:
        # Als er iets misgaat, stuur de foutmelding naar de uitgang
        ctypes.windll.user32.MessageBoxW(0, f"Fout bij het online ophalen van de OTL info. Controleer je internet of firewall. {nl}Kon de data niet ophalen vanop:{nl}{url}{nl}{nl}Foutcode:{nl}{e}", "OTL_propertysetdefinitions_aanmaken", 0)
        raise Exception(f"Fout bij ophalen OTL json van Github. Controleer je internet of firewall.\nFoutcode: {e}")
    return json_data



def OTL_dict_filter(OTL_subset, filter_subsetattributen:bool, OTL_data_dict:dict):
    """Gebruikt de OTLMOW model om info uit een OTL subset te vertalen naar een dict bruikbaar voor het opmaken van civil3D propertysets"""

    eindlijst = [] 
    try:
        if exists(OTL_subset):
            
            urilijst = select_klasses(OTL_subset) #haal een lijst van object uris op uit de OTL subset
            for uri in urilijst:
                #filter de nodige klasses uit de json
                for onderdeeldict in OTL_data_dict:
                    if onderdeeldict['typeURI'] == uri:
                        eindlijst.append(onderdeeldict)
                        break

            if filter_subsetattributen: #filter de attributen van de klasses in de subset
                for onderdeeldict in eindlijst:
                    klasse_uri = onderdeeldict['typeURI']
                    attributen_in_subset = select_attributen(OTL_subset, klasse_uri) #haal de attributen op voor deze klasse uit de subset
                    attributenlijst = onderdeeldict['attributen'] #haal de attributenlijst op uit de json
                    attributenlijst_filtered = [] #maak een nieuwe lijst voor de gefilterde attributen
                    for attribuutdict in attributenlijst:
                        attribuutnaam = attribuutdict['dotnotatie_attribuutnaam'].split('.')[-1] #pak enkel de naam van het attribuut (zonder dotnotatie)
                        if attribuutnaam in attributen_in_subset: #check of het attribuut voorkomt in de subset
                            attributenlijst_filtered.append(attribuutdict) #voeg het toe aan de nieuwe lijst
                        elif attribuutdict['dotnotatie_attribuutnaam'] == "assetId.identificator": #voeg het assetId attribuut altijd toe, ook al staat het niet in de subset
                            if attribuutdict not in attributenlijst_filtered: #check of het attribuut al toegevoegd is
                                attributenlijst_filtered.append(attribuutdict)
                        elif attribuutnaam == "typeURI": #voeg het typeURI attribuut altijd toe, ook al staat het niet in de subset
                            if attribuutdict not in attributenlijst_filtered: #check of het attribuut al toegevoegd is
                                attributenlijst_filtered.append(attribuutdict)
                    onderdeeldict['attributen'] = attributenlijst_filtered #vervang de oude lijst door de gefilterde lijst
            
        else: #Een dummy maken als er geen gebruikersinput gegeven is, zodat dynamo geen 'none' krijgt
            eindlijst = []
            onderdeeldict = dummydict()
            print("Geen OTL subset gevonden, een dummy wordt aangemaakt.")

    except Exception as e:
        ctypes.windll.user32.MessageBoxW(0, f"Er liep iets mis in het filteren van de OTL data adhv de subset:{e}", "OTL_propertysetdefinitions_aanmaken", 0)        


    return eindlijst


#UITVOEREN

subsetpad = IN[0]
subset_filter = IN[1]
objecten_filter = IN[2]
go = IN[3]

#subsetpad = r'seinbrug_en_dynbord.db'
#subset_filter = True
#objecten_filter = True
#go = 1

OUT = ""
if go:
    OTL_data_dict = OTL_info_json_afladen()
    if objecten_filter:
        resultaat = OTL_dict_filter(subsetpad, subset_filter, OTL_data_dict)
    else:
        resultaat = OTL_data_dict
        
    # CRUCIAAL VOOR DYNAMO PRESTATIES: converteer de geneste output naar een tekst-string
    OUT = json.dumps(resultaat)
# ----------------------------------------
parseJSON = Data.ParseJSON(json=otldata_to_dict)
psetdef_aanmaken = Python(IN[0]=parseJSON)  # CPython3
# ---------- psetdef_aanmaken.python (184 lines) ----------
# Load the Python Standard and DesignScript Libraries
import clr
import ctypes
import System

# Add Assemblies for AutoCAD and Civil3D
clr.AddReference('AcMgd')
clr.AddReference('AcCoreMgd')
clr.AddReference('AcDbMgd')
clr.AddReference('AecBaseMgd')
clr.AddReference('AecPropDataMgd')
clr.AddReference('AeccDbMgd')

# Import references from AutoCAD
from Autodesk.AutoCAD.Runtime import *
from Autodesk.AutoCAD.ApplicationServices import *
from Autodesk.AutoCAD.EditorInput import *
from Autodesk.AutoCAD.DatabaseServices import *
from Autodesk.AutoCAD.Geometry import *

# Import references from Civil3D
from Autodesk.Civil.ApplicationServices import *
from Autodesk.Civil.DatabaseServices import *

# Import references for PropertySets
from Autodesk.Aec.PropertyData import *
from Autodesk.Aec.PropertyData.DatabaseServices import *

# Import references for ListDefinitions
from Autodesk.Aec.DatabaseServices import ListDefinition, ListItem, DictionaryListDefinition

adoc = Application.DocumentManager.MdiActiveDocument
editor = adoc.Editor
nl = "\n"

def listdef_uit_keuzelijstoptie(lijstnaam,lijstopties):
    with adoc.LockDocument():
        with adoc.Database as db:
            ld = None
            ldid = None
            newld = False            
            with db.TransactionManager.StartTransaction() as t:
                dld = DictionaryListDefinition(db)
                try:
                    lname = lijstnaam
                    
                    if not dld.Has(lname, t):
                        ld = ListDefinition()
                        ld.AppliesToAll = True
                        ld.AlternateName = lname
                        ld.AllowToVary = False
                        ld.Description = lname

                        dld.AddNewRecord(lname, ld)
                        newld = True
                    else:
                        ldid = dld.GetAt(lname)
                        ld = t.GetObject(ldid, OpenMode.ForWrite)
                    if newld:
                        t.AddNewlyCreatedDBObject(ld, True)

                    for optie in lijstopties:
                        first = True
                        for oid in ld.GetListItems():
                            li = t.GetObject(oid, OpenMode.ForRead)
                            if li.Name == optie:
                                first = False
                                break
                        if first:
                            ld.AddListItem(optie)
                    message = ld
                    t.Commit()
                except:
                    message = "er ging iets mis met het aanmaken van lijst" + lijstnaam
    return ld.Name
    
def dict_to_psetdef(OTL_psetinfoDict):
    """OTL Data uit een dict wegschrijven naar de propertyset definitions"""
    with adoc.LockDocument():
        with adoc.Database as db:
            with db.TransactionManager.StartTransaction() as t:
                dpsd = DictionaryPropertySetDefinitions(db)
                outputlijst = []
                psetdef_count = -1
                pdn_count = -1
                for onderdeeldict in OTL_psetinfoDict:
                    od = onderdeeldict                    
                    
                    try:
                        if od["propertysetnaam"] == "OTL_dummy":
                            pass                      
                        else:
                            if not dpsd.Has(od["propertysetnaam"], t): #propertysetnaam bestaat nog niet, maak een nieuwe
                                psdef = PropertySetDefinition()
                                psdefid = psdef.Id
                                dpsd.AddNewRecord(od["propertysetnaam"], psdef)
                                newps = True #?
                                t.AddNewlyCreatedDBObject(psdef, True)
                                    
                            else: #de propertysetnaam bestaat al in de definitions, open deze
                                psdefid = dpsd.GetAt(od["propertysetnaam"])
                                psdef = t.GetObject(psdefid, OpenMode.ForWrite)
                                
                            psdef.SetToStandard(db)
                            psdef.SubSetDatabaseDefaults(db)
                            psdef.AppliesToAll = True
                            psdef.Description = od["definitie"]
                            
                            outputlijst.append(psdef.Name)
                            
                            definitions = psdef.Definitions
                            
                            psetdef_count = psetdef_count + 1                        
                                                    
                            for attribuutdict in od["attributen"]:
                                ad = attribuutdict
                                pdn_count = pdn_count + 1
                                
                                if ad["dotnotatie_attribuutnaam"]:
                                    try:
                                        if ad["civil3D_datatype_attribuut"] == "keuzelijst": #voor de keuzelijst attributen
                                            listdef_uit_keuzelijstoptie(ad["keuzelijstnaam"],ad["keuzelijstopties"])
                                            
                                            pd = PropertyDefinition()
                                            pd.Name = ad["dotnotatie_attribuutnaam"]
                                            pd.Description = ad["attribuutdefinitie"]
                                            pd.DataType = DataType.Parse(DataType, "List", True)
                                            
                                            dld = DictionaryListDefinition(db)
                                            ldid = dld.GetAt(ad["keuzelijstnaam"])
                                            pd.ListDefinitionId = ldid
                                            
                                            ldef = t.GetObject(ldid, OpenMode.ForRead)
                                            default = t.GetObject(ldef.GetListItems()[0], OpenMode.ForRead)
                                            pd.DefaultData = default.Name
                                            
                                        
                                        else: #voor alle niet keuzelijst attributen                            
                                            pd = PropertyDefinition()
                                            pd.Name = ad["dotnotatie_attribuutnaam"]
                                            pd.Description = ad["attribuutdefinitie"]
                                            pd.DataType = DataType.Parse(DataType, ad["civil3D_datatype_attribuut"], True)
                                            #pd.DefaultData = ad["civil3D_default_value"]
                                            
                                            if pd.DataType == DataType.Real:
                                                pd.DefaultData = System.Double(-999999999.000000)
                                            if pd.DataType == DataType.Integer:
                                                pd.DefaultData = System.Int32(-999999999)
                                            elif ad["dotnotatie_attribuutnaam"] == "typeURI":
                                                pd.DefaultData = str(od["typeURI"])
                                            
                                        if not definitions.Contains(pd): #dubbele keys vermijden
                                            definitions.Add(pd)
                                        
                                    except Exception as e:
                                        outputlijst = [f'Er ging iets mis bij het aanmaken van volgend attribuut: {nl}{ad["dotnotatie_attribuutnaam"]} voor {od["propertysetnaam"]} met type {ad["civil3D_datatype_attribuut"]}{nl}{e}']                    
                        
                    except Exception as e:
                        outputlijst = [f'Er ging iets mis bij het aanmaken van volgend onderdeel:{nl} {od["propertysetnaam"]}{nl}{e}']
                        
                t.Commit()

    info = str(pdn_count+1) + " Properties aangemaakt in " + str(psetdef_count+1) + " Propertysets"
    
    
    
    # Forceer elk item in de lijst naar een string om join-errors te voorkomen
    output_str_lijst = [str(item) for item in outputlijst]
    
    if len(output_str_lijst) < 30:
        message = f"{info}{nl}Volgende sets werden aangemaakt:{nl}{nl.join(output_str_lijst)}"
    else:
        message = f"{info}{nl}Onder meer volgende sets werden aangemaakt:{nl}{nl.join(output_str_lijst[:30])}{nl}..."
        outputlijst = outputlijst[:30]
        
    ctypes.windll.user32.MessageBoxW(0, message, "Propertysets aangemaakt", 0)
    return [info, outputlijst]


#UITVOEREN
OUT = "GEEN propertysets aangemaakt"
OTL_datadict = IN[0]
if OTL_datadict:
    OUT = dict_to_psetdef(OTL_datadict)
# ----------------------------------------
Propertyset_Info = Output(psetdef_aanmaken)  # Aangemaakte propertysets
